vi "index.gviweb"   [G Web Development Software 22.0.0]
panel controls:
  "stop": bool
  "Fd": f64 = 5
  "Fc": f64 = 5
  "forstyrrelse Fd": bool
  "Pause": bool
  "mauell/auto": bool
  "SKAL-verdi": f64 = 50
  "Kp": f64 = 0.5
  "Td tid": f64
  "Ti tid": f64 = 1000000
panel indicators:
  "Trendkurver for nivå": cluster{"Element 1": f64, "Element 2": f64}
  "Tank": f64
  "Fut": f64
  "Trendkurver for prosesstrømmer": T1
  "Er verdi": f64
  "F_c": f64
  "F_d": f64
types:
  T1 = cluster{"Element 1": f64, "Element 2": f64, "Element 3": f64}
diagram:
  s1 = 50  # shift register
  s2 = 0  # shift register
  s3 = 0  # shift register
  s4 = 0  # shift register
  while {
    Build Cluster(s1, $"SKAL-verdi") -> w1
    $"Trendkurver for nivå" <- w1
    $Tank <- s1
    $F_d <- $Fd
    In Range And Coerce(lower limit=0, upper limit=10, x=$Fc) -> (coerced(x)=w2)
    $F_c <- w2
    Build Cluster($Fd, w2, $Fut) -> w3
    $"Trendkurver for prosesstrømmer" <- w3
    Add($Fd, w2) -> w4
    Subtract(x=w4, y=$Fut) -> w5
    Add(w5, s1) -> w6
    In Range And Coerce(lower limit=0, upper limit=100, x=w6) -> (coerced(x)=w7)
    $"Er verdi" <- w7
    Square Root(x=s1) -> w8
    Square Root(x=2) -> w9
    Multiply(w8, w9) -> w10
    $Fut <- w10
    case ($"mauell/auto") {
      frame False, Default {
        w11 = s3
        w12 = s4
      }
      frame True {
        Subtract(x=$"SKAL-verdi", y=$"Er verdi") -> w11
        Subtract(x=w11, y=s3) -> w13
        Divide(x=w13, y=0.25) -> w14
        Multiply($Kp, w14) -> w15
        Multiply(w15, $"Td tid") -> w16
        Multiply(w11, $Kp) -> w17
        Add(w11, s3) -> w18
        Divide(x=w18, y=2) -> w19
        Multiply(w19, 0.25) -> w20
        Add(w20, s4) -> w12
        Multiply($Kp, w12) -> w21
        Divide(x=w21, y=$"Ti tid") -> w22
        Add(w17, w22) -> w23
        Add(w23, w16) -> w24
        $Fc <- w24
      }
    }
    case ($"forstyrrelse Fd") {
      frame False, Default {
        w25 = 0
      }
      frame True {
        Increment(x=s2) -> w26
        Is Greater(x=w26, y=40) -> w27
        Select(s=w27, t=0, f=w26) -> w25
        Is Less(x=s2, y=1) -> w28
        case (w28) {
          frame False, Default { }
          frame True {
            Random Number() -> (number (0 to 1)=w29)
            Multiply(w29, 10) -> w30
            $Fd <- w30
          }
        }
      }
    }
    case ($Pause) {
      frame False, Default { }
      frame True {
        while {
          Not(x=$Pause) -> w31
          stop if w31
        }
      }
    }
    Wait(time to wait=250)
    next s1 = w7
    next s2 = w25
    next s3 = w11
    next s4 = w12
    stop if $stop
  }
